# Grasshopper definition GH01_GeomConversionTesting.gh (Grasshopper 1.0.6)
# plug-ins: UserDataUtils

cud = CreateCustomUserData(A="asdf")
ellipse = Ellipse(
    Plane=Plane(origin=(-263, -4, 0), x=(0.6401843997, 0.7682212796, 0), y=(0.7682212796, -0.6401843997, 0)),
    Radius1=3,
    Radius2=1)  # -> Ellipse, Focus1, Focus2
sud = SetUserData(Object=ellipse.Ellipse, UserData=cud)

# ---- group: Select something in rhino and click this dude
rsel = RhSelection(x=Toggle(False))  # -> out, A, B
# ---------- rsel: C# usings ----------
using System.IO;
using System.Linq;
using System.Data;
using System.Drawing;
using System.Reflection;
using System.Windows.Forms;
using System.Xml;
using System.Xml.Linq;
using System.Runtime.InteropServices;

using Rhino.DocObjects;
using Rhino.Collections;
using GH_IO;
using GH_IO.Serialization;
# ---------- rsel: C# ----------
    A = RhinoDoc.ActiveDoc.Objects.GetSelectedObjects(true, true).Select(xxx => xxx.Geometry);

    B = RhinoDoc.ActiveDoc.Objects.GetSelectedObjects(true, true).Select(xxx => xxx.Geometry.GetType());
# ---------- end rsel ----------

# ----
panel = Panel(rsel.B)
srl = Serialiser(Object=rsel.A)  # -> ConversionResultString, ConversionResult
dsr = Deserialiser(Object=srl.ConversionResult)
geo = Geometry(dsr)
srl_2 = Serialiser(Object=geo)  # -> ConversionResultString, ConversionResult
c_script = CSharpScript(x=srl_2.ConversionResult, y=srl.ConversionResult)  # -> out, A, B
# ---------- c_script: C# ----------
    if(x == null || y == null) return;
    
    var hash1 = x.GetType().GetProperty("Hash").GetValue(x, null) as string;
    var hash2 = y.GetType().GetProperty("Hash").GetValue(y, null) as string;

    A = hash1 == hash2;
    B = hash1 + " vs " + hash2;
# ---------- end c_script ----------
panel_2 = Panel(srl.ConversionResultString)

# ---- group: Theoretically, hashes should be the same after a serialisation run
are_the_hashes_equal = Panel(c_script.A)
panel_3 = Panel(c_script.B)

# ----
panel_4 = Panel(srl_2.ConversionResultString)
